# Grasshopper definition reinf_main.gh (Grasshopper 1.0.7)

# ---- group: input problem
# COMPUTATION
number_slider = Slider(1.1, range=0..5)
# VISUALS
# RESULTS
max_dist = Slider(0.2, range=0..5)
number_slider_2 = Slider(2, range=0..10)
number_slider_3 = Slider(0.26, range=0..10)
number_slider_4 = Slider(0.05, range=0..10)
python = GhPythonScript(
    lx=number_slider_3,
    ly=Slider(0.26, range=0..10),
    lz=number_slider_4,
    nx=number_slider_2,
    ny=Slider(2, range=0..20),
    nz=Slider(1, range=0..10),
    init_dist=number_slider,
    max_dist=max_dist)  # -> out, points, lines, start_idx, end_idx, supports, loads, init_set, comp_str, tens_str; inputs nx: Int32, ny: Int32, nz: Int32
# ---------- python: Python ----------
import rhinoscriptsyntax as rs
import itertools as it
from compas.datastructures import Network
from compas.geometry import distance_point_point

# geometry

nodes = [[x * lx / nx, y * ly / ny, z * lz / nz] for x, y, z in it.product(range(nx + 1), range(ny + 1), range(nz + 1))]
edges = [(u, v) for u, v in it.combinations(range(len(nodes)), 2) if distance_point_point(nodes[u], nodes[v]) < max_dist]
ntk = Network.from_nodes_and_edges(nodes, edges)

points = [rs.AddPoint(ntk.node_coordinates(key)) for key in ntk.nodes()]
lines = [rs.AddLine(ntk.node_coordinates(u), ntk.node_coordinates(v)) for u, v in ntk.edges()]

# statics system

loads = []
supports = []
for key in ntk.nodes():
    x, y, z = ntk.node_coordinates(key)
    
    if ((x == 0 and y == 0) or (x == 0 and y == ly) or (x == lx and y == 0) or (x == lx and y == ly)) and z == 0:
    #if (y == 0 or y == ly) and z == 0:
        supports.append(rs.AddPoint([1, 1, 0]))
    else:
        supports.append(rs.AddPoint([1, 1, 1]))
    
    if z == lz:
        loads.append(rs.AddPoint([0.0, 0.0, -0.0001]))
    else:
        loads.append(rs.AddPoint([0.0, 0.0, 0.0]))

# line attributes

start_idx, end_idx = [], [] # extremity vertices
init_set = [] # is line include in initial set for optimisation
comp_str = [] # compressive strength
tens_str = [] # tensile strength
for u, v in ntk.edges():
    ux, uy, uz = ntk.node_coordinates(u)
    vx, vy, vz = ntk.node_coordinates(v)
    
    start_idx.append(u)
    end_idx.append(v)
    
    if ntk.edge_length(u, v) < init_dist:
        init_set.append(True)
    else:
        init_set.append(False)
    
    comp_str.append(1.0)
    
    #tens_str.append(1.0)
    
    if uz == vz or (ux == vx and uy == vy):
        tens_str.append(1.0)
    else:
        tens_str.append(0.0)
# ---------- end python ----------

# ---- group: plot system
line = Line(python.lines)
len = Length(Curve=line)
rev = Reverse(Vector=python.supports)
vec = VectorXYZ(XComponent="1", YComponent="1", ZComponent="1")  # -> Vector, Length
smaller = SmallerThan(FirstNumber=len, SecondNumber=max_dist)  # -> SmallerThan, OrEqualTo
dispatch = Dispatch(List=line, DispatchPattern=smaller.SmallerThan)  # -> ListA, ListB
addition = Addition(A=vec.Vector, B=rev)
vdis = VectorDisplay(Anchor=python.points, Vector=addition)
vdis_2 = VectorDisplay(Anchor=python.points, Vector=python.loads)
preview = CustomPreview(Geometry=dispatch.ListA, Material=ColourSwatch(SwatchColor=RGB(127, 127, 127)))

# ---- group: optimisation
python_2 = GhPythonScript(
    points=python.points,
    supports=python.supports,
    loads=python.loads,
    start_point_indices=python.start_idx,
    end_point_indices=python.end_idx,
    compressive_strengths=python.comp_str,
    tensile_strengths=python.tens_str,
    in_initial_set=python.init_set)  # -> out, lines, sections, forces; inputs points: list, supports: list, loads: list, start_point_indices: list of Int32, end_point_indices: list of Int32, compressive_strengths: list, tensile_strengths: list, in_initial_set: list of Boolean
# ---------- python_2: Python ----------
import rhinoscriptsyntax as rs
import itertools as it
from compas.rpc import Proxy
import acorn_reinforcement

# constrained layout optimisation

proxy = Proxy("acorn_reinforcement.optimisation")
#proxy.restart_server()
lo2 = proxy.lo2

nodes = [([xyz for xyz in rs.PointCoordinates(point)], [xyz for xyz in rs.PointCoordinates(support)], [xyz for xyz in rs.PointCoordinates(load)]) for point, support, load in zip(points, supports, loads)]
lines = [(i, j, cs, ts, include) for i, j, cs, ts, include in zip(start_point_indices, end_point_indices, compressive_strengths, tensile_strengths, in_initial_set)]

Nd, Cn, a, q = lo2(nodes, lines)

threshold = 1e-6
lines = [rs.AddLine(Nd[int(cn[0])], Nd[int(cn[1])]) for i, cn in enumerate(Cn) if a[i] > threshold]
sections = [ai for ai in a if ai > threshold]
forces = [qi for i, qi in enumerate(q[0]) if a[i] > threshold]
# ---------- end python_2 ----------

# ---- group: struts and ties
multiplication = Multiplication(A=number_slider_3, B="1.5")
python_3 = GhPythonScript(lines=python_2.lines, sections=python_2.sections, forces=python_2.forces, threshold="1e-6")  # -> out, struts, ties; inputs lines: list, sections: list, forces: list
# ---------- python_3: Python ----------
import rhinoscriptsyntax as rs
from math import pi

# get compressive struts and tensile ties

struts, ties = [], []
for line, section, force in zip(lines, sections, forces):
    if abs(force) > threshold:
        pipe = rs.AddPipe(line, 0, (section / pi) ** .5, blend_type=1, cap=1, fit=False)
        if force > 0:
            ties += pipe
        else:
            struts += pipe
# ---------- end python_3 ----------
X = UnitX(Factor=multiplication)
move = Move(Geometry=python_3.ties, Motion=X)  # -> Geometry, Transform
move_2 = Move(Geometry=python_3.struts, Motion=X)  # -> Geometry, Transform
preview_2 = CustomPreview(Geometry=move_2.Geometry, Material=ColourSwatch(SwatchColor=RGB(0, 0, 255)))
preview_3 = CustomPreview(Geometry=move.Geometry, Material=ColourSwatch(SwatchColor=RGB(255, 0, 0)))

# ---- group: element sizing
filament_axial_strength_mpa = Panel("50")
filament_cross_section_area_m2 = Panel("0.000000001")
python_4 = GhPythonScript(lines=python_2.lines, forces=python_2.forces, threshold="1e-6")  # -> out, vert_reinf_lines, vert_reinf_forces; inputs lines: list, forces: list
# ---------- python_4: Python ----------
import rhinoscriptsyntax as rs

# get the vertical tensile lines and forces

vert_reinf_lines, vert_reinf_forces = [], []
for line, force in zip(lines, forces):
    if force > threshold:
        ax, ay, az = rs.CurveStartPoint(line)
        bx, by, bz = rs.CurveEndPoint(line)
        if ax == bx and ay == by:
            vert_reinf_lines.append(line)
            vert_reinf_forces.append(force)
# ---------- end python_4 ----------
python_5 = GhPythonScript(
    lines=python_2.lines,
    forces=python_2.forces,
    threshold="1e-6",
    zmin="0",
    zmax=number_slider_4,
    fil_str=filament_axial_strength_mpa,
    fil_sec=filament_cross_section_area_m2)  # -> out, bottom_reinf, top_reinf; inputs lines: list, forces: list
# ---------- python_5: Python ----------
import rhinoscriptsyntax as rs
from math import ceil

# get the reinforcement at the top and the bottom surfaces
# sized by filament strength in MPa and cross-section in m2

bottom_reinf, top_reinf = [], []
for line, force in zip(lines, forces):
    if force > threshold:
        ax, ay, az = rs.CurveStartPoint(line)
        bx, by, bz = rs.CurveEndPoint(line)
        n = int(ceil(force / (fil_str * fil_sec * 1000)))
        if az == zmin and bz == zmin:
            bottom_reinf += [line] * n
        elif az == zmax and bz == zmax:
            top_reinf += [line] * n
# ---------- end python_5 ----------

# ---- group: eulerisation
python_6 = GhPythonScript(required_lines=python_5.bottom_reinf)  # -> out, polyline; inputs required_lines: list
# ---------- python_6: Python ----------
import rhinoscriptsyntax as rs
import itertools as it
from compas.rpc import Proxy
import acorn_reinforcement
from compas.utilities import geometric_key

# eulerisation to find a continuous through the lines

proxy_euler = Proxy("acorn_reinforcement.eulerisation")
#proxy_euler.restart_server()
rpp = proxy_euler.rpp

required_lines = required_lines or []
optional_lines = optional_lines or []

count = 0
geom_keys = {}
for line in required_lines + optional_lines:
    for point in (rs.CurveStartPoint(line), rs.CurveEndPoint(line)):
        point = [xyz for xyz in point]
        if geometric_key(point) not in geom_keys:
            geom_keys[geometric_key(point)] = (point, count)
            count += 1

key_to_xyz ={key: xyz for xyz, key in geom_keys.values()} 

required_lines = [(geom_keys[geometric_key(rs.CurveStartPoint(line))][1], geom_keys[geometric_key(rs.CurveEndPoint(line))][1]) for line in required_lines]
optional_lines = [(geom_keys[geometric_key(rs.CurveStartPoint(line))][1], geom_keys[geometric_key(rs.CurveEndPoint(line))][1]) for line in optional_lines]

edges = rpp(required_lines, optional_lines, key_to_xyz)

if len(edges) != 0:
    polyline = rs.AddPolyline([key_to_xyz[edges[0][0]]] + [key_to_xyz[edge[1]] for edge in edges])
else:
    polyline = None
# ---------- end python_6 ----------

# ---- group: plot passes
python_7 = GhPythonScript(polyline=python_6.polyline)  # -> out, unique_lines, counts; inputs polyline: list
# ---------- python_7: Python ----------
import rhinoscriptsyntax as rs
from compas.utilities import geometric_key, reverse_geometric_key

# count passes per line

lines = rs.ExplodeCurves(polyline)

line_count = {}
for line in lines:
    u_gk = geometric_key(rs.CurveStartPoint(line))
    v_gk = geometric_key(rs.CurveEndPoint(line))
    if (u_gk, v_gk) in line_count:
        line_count[(u_gk, v_gk)] += 1
    elif (v_gk, u_gk) in line_count:
        line_count[(v_gk, u_gk)] += 1
    else:
        line_count[(u_gk, v_gk)] = 1

unique_lines = []
counts = []
for (u_gk, v_gk), count in line_count.items():
    u_xyz = reverse_geometric_key(u_gk)
    v_xyz = reverse_geometric_key(v_gk)
    unique_lines.append(rs.AddLine(u_xyz, v_xyz))
    counts.append(count)
# ---------- end python_7 ----------
sort = SortList(Keys=python_7.counts)  # -> Keys, ValuesA
item = ListItem(List=reverse(sort.Keys), Index=0, Wrap=True)
item_2 = ListItem(List=sort.Keys, Index=0, Wrap=True)
gradient = Gradient(
    LowerLimit=item_2,
    UpperLimit=item,
    Parameter=python_7.counts,
    stops=[0: RGB(0, 128, 0), 0.5: RGB(255, 255, 0), 1: RGB(255, 0, 0)])
multiplication_2 = Multiplication(A=X, B="2")
move_3 = Move(Geometry=python_7.unique_lines, Motion=multiplication_2)  # -> Geometry, Transform
preview_4 = CustomPreview(Geometry=move_3.Geometry, Material=gradient)

# ---- group: wound path
# strictly higer than 2!
number_slider_5 = Slider(0.003, range=0..0.01)
lx = Expression(lx=number_slider_3, nx=number_slider_2, k="4", Expression="lx / nx / k")
python_8 = GhPythonScript(polyline=python_6.polyline, h_offset=lx, v_offset=number_slider_5)  # -> out, total_path
# ---------- python_8: Python ----------
from math import pi
import rhinoscriptsyntax as rs
from acorn_reinforcement.winding import wind_polyline
from compas.utilities import geometric_key, pairwise, window
from compas.geometry import length_vector, add_vectors, subtract_vectors, scale_vector, normalize_vector, centroid_points, centroid_points_weighted, angle_points, angle_vectors, cross_vectors, dot_vectors, rotate_points

# horizontal offset of the polyline

vertices = rs.PolylineVertices(polyline)

wound_lines = wind_polyline(vertices, h_offset)

# mark if path is straight to simplify path later
is_path_straight = [False] + [b == c for (a, b), (c, d) in pairwise(wound_lines)] + [False]

# vertical offset at the nodes

points = {}
for vertex in vertices:
    gkey = geometric_key(vertex)
    if gkey not in points:
        points[gkey] = -1

offset_nb = []
for vertex in vertices:
    gkey = geometric_key(vertex)
    points[gkey] += 1
    offset_nb.append(points[gkey])

top_offset = max(offset_nb) + 3
offset_vect = [0.0, 0.0, v_offset]
offset_vertices = [add_vectors(vertex, scale_vector(offset_vect, offset_nb[i])) for i, vertex in enumerate(vertices)]

# differentiated vertical offset of the polyline lines and sublines

offset_wound_lines = []
for i, (a, f) in enumerate(wound_lines):
    # create polylines (a, b, c, d, e, f) with three horizontal lines and two vertical lines
    af = normalize_vector(subtract_vectors(f, a))
    af_start = scale_vector(af, h_offset)
    af_end = af_1 = scale_vector(af_start, -1)
    b = add_vectors(a, af_start)
    e = add_vectors(f, af_end)
    c = add_vectors(b, scale_vector(offset_vect, top_offset))
    d = add_vectors(e, scale_vector(offset_vect, top_offset))
    a0 = add_vectors(a, scale_vector(offset_vect, top_offset))
    a = add_vectors(a, scale_vector(offset_vect, offset_nb[i]))
    b = add_vectors(b, scale_vector(offset_vect, offset_nb[i]))
    e = add_vectors(e, scale_vector(offset_vect, offset_nb[i + 1]))
    f0 = add_vectors(f, scale_vector(offset_vect, top_offset))
    f = add_vectors(f, scale_vector(offset_vect, offset_nb[i + 1]))
    straight_start, straight_end = is_path_straight[i], is_path_straight[i + 1]
    if not straight_start and not straight_end:
        offset_wound_lines.append([a, b, c, d, e, f])
    elif straight_start and not straight_end:
        offset_wound_lines.append([a0, d, e, f])
    elif not straight_start and straight_end:
        offset_wound_lines.append([a, b, c, f0])
    else:
        offset_wound_lines.append([a0, f0])

# complete total path with arc elements around nodes between lines

total_path = []

for i, vertex in enumerate(offset_vertices[1:-1]):
    prev_line, next_line = offset_wound_lines[i : i + 2]
    prev_pt, next_pt = prev_line[-1], next_line[0]
    
    # initial loop to lock
    if i == 0:
        a = prev_line[0]
        centre = [vertices[0][0], vertices[0][1], a[2]]
        direction = normalize_vector(subtract_vectors(prev_line[0], prev_line[1]))
        b = add_vectors(centre, scale_vector(direction, h_offset))
        c = add_vectors(centre, subtract_vectors(centre, a))
        total_path.append(rs.AddArc3Pt(a, c, b))
    
    total_path.append(rs.AddPolyline(prev_line))
    
    # connect with arcs
    if geometric_key(prev_pt) != geometric_key(next_pt):
        mid_pt = centroid_points([prev_pt, next_pt])
        prev_dir = normalize_vector(subtract_vectors(prev_line[-1], prev_line[-2]))
        next_dir = normalize_vector(subtract_vectors(next_line[1], next_line[0]))
        dir = normalize_vector(add_vectors(prev_dir, scale_vector(next_dir, -1)))
        arc_pt = add_vectors(scale_vector(dir, h_offset), vertex)
        total_path.append(rs.AddArc3Pt(prev_pt, next_pt, arc_pt))
    
    if i == len(offset_vertices[1:-1]) - 1:
        total_path.append(rs.AddPolyline(next_line))
        # final loop to lock
        a = next_line[-1]
        centre = [vertices[-1][0], vertices[-1][1], a[2]]
        direction = normalize_vector(subtract_vectors(next_line[-1], next_line[-2]))
        b = add_vectors(centre, scale_vector(direction, h_offset))
        c = add_vectors(centre, subtract_vectors(centre, a))
        total_path.append(rs.AddArc3Pt(a, c, b))
# ---------- end python_8 ----------

# ---- group: result summary
# filament length BEFORE eulerisation [m]
# filament length AFTER eulerisation [m]
# filament volume AFTER eulerisation [cm3]
# min number of passes AFTER eulerisation [-]
# max number of passes AFTER eulerisation [-]
# tool path length [m]
len_2 = Length(Curve=python_6.polyline)
len_3 = Length(Curve=python_5.bottom_reinf)
len_4 = Length(Curve=python_8.total_path)
multiplication_3 = Multiplication(A=len_2, B=filament_cross_section_area_m2)
ma = MassAddition(Input=len_3)  # -> Result, PartialResults
ma_2 = MassAddition(Input=len_4)  # -> Result, PartialResults
multiplication_4 = Multiplication(A=multiplication_3, B="1e6")
merge = Merge(
    Data1=flatten(ma.Result),
    Data2=flatten(len_2),
    Data3=flatten(multiplication_4),
    Data4=flatten(item_2),
    Data5=flatten(item),
    Data6=flatten(ma_2.Result))
panel = Panel(merge)

# ----
panel_2 = Panel(python_8.out)

# ---- group: plot path
multiplication_5 = Multiplication(A=X, B="3")
move_4 = Move(Geometry=python_8.total_path, Motion=multiplication_5)  # -> Geometry, Transform
explode = Explode(Curve=move_4.Geometry, Recursive=True)  # -> flatten(Segments), Vertices
lng = ListLength(List=move_4.Geometry)
curvepoint = PointOnCurve(explode.Segments, parameter=0.5)
series = Series(Start=0, Step=1, Count=lng)
gradient_2 = Gradient(
    LowerLimit=0,
    UpperLimit=lng,
    Parameter=series,
    stops=[0: RGB(234, 38, 0), 0.25: RGB(234, 126, 0), 0.5: RGB(254, 244, 84), 0.75: RGB(173, 203, 249), 1: RGB(75, 107, 169)])
pdecon = Deconstruct(Point=curvepoint)  # -> XComponent, YComponent, ZComponent
sort_2 = SortList(Keys=pdecon.ZComponent)  # -> Keys, ValuesA
item_3 = ListItem(List=reverse(sort_2.Keys), Index=0, Wrap=True)
item_4 = ListItem(List=sort_2.Keys, Index=0, Wrap=True)
preview_5 = CustomPreview(Geometry=move_4.Geometry, Material=gradient_2)
gradient_3 = Gradient(
    LowerLimit=item_4,
    UpperLimit=item_3,
    Parameter=pdecon.ZComponent,
    stops=[0: RGB(234, 38, 0), 0.119: RGB(234, 126, 0), 0.247: RGB(254, 244, 84), 0.694: RGB(173, 203, 249), 1: RGB(75, 107, 169)])
preview_6 = CustomPreview(Geometry=explode.Segments, Material=gradient_3)

# ----
join = JoinCurves(Curves=python_8.total_path, Preserve=False)
crv = Curve(join)
